# Grasshopper definition Criação de Superfície Helicoidal.gh (Grasshopper 1.0.7)

distancia_do_ponto = Slider(6, range=1..10)
neg = Negative(Value=distancia_do_ponto)
distancia_entre_as_linahs = Slider(1, range=1..10)
pt = Point(<point referenced from the Rhino model>)
X = UnitX(Factor=distancia_do_ponto)
X_2 = UnitX(Factor=neg)
nuero_de_linhas = Slider(20, range=0..100)
rotação = Slider(43, range=0..90)
move = Move(Geometry=pt, Motion=X)  # -> Geometry, Transform
move_2 = Move(Geometry=pt, Motion=X_2)  # -> Geometry, Transform
ln = Line(StartPoint=move.Geometry, EndPoint=move_2.Geometry)
series = Series(Start=0, Step=distancia_entre_as_linahs, Count=nuero_de_linhas)
series_2 = Series(Start=0, Step=rotação, Count=nuero_de_linhas)
Z = UnitZ(Factor=series)
move_3 = Move(Geometry=ln, Motion=Z)  # -> Geometry, Transform
line = LineSDL(Start=pt, Direction=Vector(0, 0, 1), Length=1)
rotax = RotateAxis(Geometry=move_3.Geometry, Angle=degrees(series_2), Axis=line)  # -> Geometry, Transform
loft = Loft(Curves=rotax.Geometry, Options={Adjust=False, Closed=False, LoftEnds=0, LoftSimp=0, LoftType=0, Rebuild=10, Refit=0.01})
