# Grasshopper definition Fita de Moebius.gh (Grasshopper 1.0.7)

number_slider = Slider(100, range=1..100)
crv = Curve(<curve referenced from the Rhino model>)
pframe = PerpFrame(Curve=crv, Parameter=0)
divide = DivideCurve(Curve=crv, Count=number_slider, Kinks=False)  # -> Points, Tangents, Parameters
pframe_2 = PerpFrame(Curve=crv, Parameter=divide.Parameters)
ins = InsertItems(List=pframe_2, Item=pframe, Indices=number_slider, Wrap=True)
deplane = DeconstructPlane(Plane=ins)  # -> Origin, XAxis, YAxis, ZAxis
amp = Amplitude(Vector=deplane.XAxis, Amplitude=Slider(2.3, range=0.25..5))
rev = Reverse(Vector=amp)
move = Move(Geometry=deplane.Origin, Motion=amp)  # -> Geometry, Transform
move_2 = Move(Geometry=deplane.Origin, Motion=rev)  # -> Geometry, Transform
multiplication = Multiplication(A="180", B=Slider(2, range=1..5))
ln = Line(StartPoint=move.Geometry, EndPoint=move_2.Geometry)
dom = ConstructDomain(DomainStart=0, DomainEnd=multiplication)
range = Range(Domain=dom, Steps=number_slider)
rotate = Rotate(Geometry=ln, Angle=degrees(range), Plane=ins)  # -> Geometry, Transform
end = EndPoints(Curve=rotate.Geometry)  # -> Start, End
pline = PolyLine(Vertices=end.Start, Closed=False)
pline_2 = PolyLine(Vertices=end.End, Closed=False)
loft = Loft(
    Curves=[pline_2, pline],
    Options={Adjust=False, Closed=False, LoftEnds=0, LoftSimp=0, LoftType=0, Rebuild=10, Refit=0.01})
