# Grasshopper definition SenoideAtravezDeUmVetorEcriacaoDeSuperficies.gh (Grasshopper 1.0.7)

pontos = Slider(28, range=1..100)
comprimento = Slider(66, range=0..180)
crv = Curve(<curve referenced from the Rhino model>)
addition = Addition(A=pontos, B=1)
amplitude = Slider(0.44, range=0.25..5)
series = Series(Start=0, Step=comprimento, Count=addition)
sin = Sine(Value=degrees(series))
altura = Slider(6, range=0..180)
divide = DivideCurve(Curve=crv, Count=pontos, Kinks=False)  # -> Points, Tangents, Parameters
pdecon = Deconstruct(Point=divide.Points)  # -> XComponent, YComponent, ZComponent
multiplication = Multiplication(A=sin, B=amplitude)
Z = UnitZ(Factor=multiplication)
pontos_2 = Slider(14, range=1..100)
move = Move(Geometry=divide.Points, Motion=Z)  # -> Geometry, Transform
pt = ConstructPoint(XCoordinate=pdecon.XComponent, YCoordinate=0, ZCoordinate=pdecon.ZComponent)
Z_2 = UnitZ(Factor=altura)
Y = UnitY(Factor=pontos_2)
move_2 = Move(Geometry=move.Geometry, Motion=Z_2)  # -> Geometry, Transform
move_3 = Move(Geometry=pt, Motion=Y)  # -> Geometry, Transform
pline = PolyLine(Vertices=move_2.Geometry, Closed=False)
pline_2 = PolyLine(Vertices=pt, Closed=False)
pline_3 = PolyLine(Vertices=move_3.Geometry, Closed=False)
loft = Loft(
    Curves=[pline_2, pline],
    Options={Adjust=False, Closed=False, LoftEnds=0, LoftSimp=0, LoftType=0, Rebuild=10, Refit=0.01})
loft_2 = Loft(
    Curves=[pline_3, pline],
    Options={Adjust=False, Closed=False, LoftEnds=0, LoftSimp=0, LoftType=0, Rebuild=10, Refit=0.01})
